# Grasshopper definition runner_for_exercise.ghx (Grasshopper 1.0.8)
# plug-ins: RhinoCodePluginGH

number_slider = Slider(24, range=6..30)  # disabled
number_slider_2 = Slider(4, range=3..6)  # disabled
geo = Geometry([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])  # disabled
panel = Panel("-1")  # disabled
panel_2 = Panel("1")  # disabled
panel_3 = Panel("-1")  # disabled
loft = Loft(Curves=geo, Options={Adjust=False, Closed=False, LoftEnds=0, LoftSimp=0, LoftType=0, Rebuild=10, Refit=0.01})  # disabled
vec = VectorXYZ(XComponent=panel, YComponent=panel_2, ZComponent=panel_3)  # -> Vector, Length; disabled
geo_2 = Geometry([Point(44.05993319, 7.100836505, 0), Point(35.74294356, -5.999632106, 0), Point(50.43181324, -0.6252468599, 0)])
py3 = Python3Script(mass=loft, divide=number_slider, dist=number_slider_2, sunlight_vec=vec.Vector)  # -> out, breps; inputs mass: Brep, divide: Int32, dist: Double, sunlight_vec: Vector3d; disabled
# ---------- py3: Python ----------
from logic import Triangulizer

# 삼각 분할
triangulizer = Triangulizer(mass)

# 파사드
facade = triangulizer.get_facade(divide, dist)

# 채광에 반응
breps = facade.get_breps(sunlight_vec)
# ---------- end py3 ----------
py3_2 = Python3Script(pts=geo_2, ratio=Slider(0, range=0..1))  # -> out, base_crvs, crvs; inputs pts: list of Point3d, ratio: Double
# ---------- py3_2: Python ----------
from logic.exercise.triangle_panel import TriModule

tri_module = TriModule(*pts)
base_crvs = tri_module.crvs
crvs = tri_module.crvs_at_ratio(ratio)
# ---------- end py3_2 ----------
panel_4 = Panel(py3.out)  # disabled
boundary = BoundarySurfaces(Edges=py3_2.crvs)
area = Area(Geometry=boundary)  # -> Area, Centroid
ma = MassAddition(Input=area.Area)  # -> Result, PartialResults
panel_5 = Panel(ma.Result)

# ---- group: Module Watcher
toggle = BooleanToggle(True)
button = Button()

# ----
modulereloader = Python3Script(watch=toggle, reload=button)  # -> out; inputs watch: Boolean, reload: Boolean
# ---------- modulereloader: Python ----------
import os
import sys
import Grasshopper as gh
import scriptcontext as sc


def recompute_doc(e):
    for obj in ghenv.Component.OnPingDocument().Objects:
        if not obj.InstanceGuid == ghenv.Component.InstanceGuid:
            obj.ExpireSolution(False)


# Import가 제대로 작동하도록 PATH를 업데이트한다.
root_dir = os.path.dirname(ghdoc.Path)
if root_dir not in sys.path:
    sys.path.append(root_dir)
    # 로직 모듈을 불러들여 놓는다.
    import logic
    remember_key = "recomputed"
    if remember_key not in sc.sticky:
        # 그래스호퍼 문서 전체의 Recompute를 수행한다.
        sc.sticky[remember_key] = True
        ghenv.Component.OnPingDocument().ScheduleSolution(
            100, 
            recompute_doc
        )


from develop import watch_modules, reload_modules


watch_modules(watch)
reload_modules(reload)
# ---------- end modulereloader ----------

# ---- group: Module Watcher (continued)
panel_6 = Panel(modulereloader)
